vi "main.gviweb"   [LabVIEW NXG 4.0.0]
panel indicators:
  "Card_1": T1
  "Card_2": T1
  "Card_3": T1
  "Card_4": T1
  "Card_5": T1
  "Card_6": T1
  "Card_7": T1
  "Card_8": T1
  "URL Image": string
types:
  T1 = cluster{"AE-Photo": string, "Radial Progress Bar": f64, "CurrentStatePeriod": string, "FullName": string, "ColorCircle": string, "CardBackground": string}
diagram:
  Build Cluster("Photos/Sha%20Wang.jpg", 33, "09:55", "Yi Xu", "Resources/greenCircle.png", "Resources/CardBG.png") -> w1
  $Card_1 <- w1
  $Card_2 <- w1
  $Card_3 <- w1
  $Card_4 <- w1
  $Card_5 <- w1
  Property Node(instance in=reference to "Card_1") -> ("Value"=w2)
  Property Node(instance in=w2)
  $Card_6 <- w1
  $Card_7 <- w1
  $Card_8 <- w1
