vi "main.gvi"   [LabVIEW NXG 4.0.0]
panel controls:
  "error in": error
  "stop": bool
panel indicators:
  "error out": error
  "loop iteration": i32
  "loop iteration_2": i32
uses:
  desktop::python.gvi
  desktop::text.gvi
diagram:
  w1 = $"error in"
  while (iteration -> i1) {
    $"loop iteration" <- i1
    call "python.gvi"(error in=w1) -> (error out=w2)
    call "text.gvi"(error in=w2) -> (basicState Array=w3, aeState Array=w4, error out=w5)
    Array Size(array=w4) -> (size(s)=w6)
    Array To Cluster[NumberOfClusterElements=9](array=w6) -> (cluster=w7)
    Property Node(instance in=w7) -> ("Element 0"=w8)
    for (N = w8) {
      w9 = each element of w4
      Array To Cluster[NumberOfClusterElements=7](array=w9) -> (cluster=w10)
      Property Node(instance in=w10) -> ("Element 4"=w11)
      case (w11) {
        frame "False", Default { }
        frame "Free" { }
        frame "Busy" { }
        frame "Away" { }
      }
    }
    Array To Cluster[NumberOfClusterElements=6](array=w3) -> (cluster=w12)
    Property Node(instance in=w12)
    stop if $stop
  }
  $"error out" <- w5
  while (iteration -> i2) (after w1) {
    Wait(time to wait=1000)
    $"loop iteration_2" <- i2
    stop if $stop
  }
